# Grasshopper definition 02_iaac_damage_evaluation.ghx (Grasshopper 1.0.8)
# plug-ins: MetaHopper

panel = Panel("stack1_brick23")
concat = Concatenate(FragmentA="stack", FragmentB=Slider(1, range=1..2), FragmentC="_brick", FragmentD=Slider(25, range=0..49))
custom_damage_mapping = Panel("""{
  "crack": 2,
  "spalling": 3,
  "material loss": 5,
  "staining": 1,
  "chipping": 4
}""")
assembly_path = Python3Script(filename="material_stack_1_with_damages")  # -> out, DATA
# ---------- assembly_path: Python ----------
import os
import getpass

username = getpass.getuser()
USER_FOLDER = os.path.abspath(os.path.join("C:/Users/", username))
DATA = os.path.abspath(os.path.join(USER_FOLDER,"workspace/projects/workshop_iaac_2026/data/assembly/{}.json".format(filename)))

print(USER_FOLDER)
print(DATA)
# ---------- end assembly_path ----------
damaged_brick_path = Python3Script(filename=concat)  # -> out, DATA
# ---------- damaged_brick_path: Python ----------
import os
import getpass

username = getpass.getuser()
USER_FOLDER = os.path.abspath(os.path.join("C:/Users/", username))
DATA = os.path.abspath(os.path.join(USER_FOLDER,"workspace/projects/workshop_iaac_2026/data/stacked_brick_dataset_for_testing/brick_dataset/{}.json".format(filename)))

print(USER_FOLDER)
print(DATA)
# ---------- end damaged_brick_path ----------
panel_2 = Panel(concat)
py3 = Python3Script(json_path=assembly_path.DATA, damage_map=custom_damage_mapping)  # -> out, T_planes, T_dims, T_ids, T_damage_value, T_damage_status_int, T_damage_status_txt, T_damage_vertices, T_damage_uv, T_damage_desc; inputs damage_map: String
# ---------- py3: Python ----------
import json
import Rhino.Geometry as rg
from Grasshopper import DataTree
from Grasshopper.Kernel.Data import GH_Path

# =========================
# INPUTS
# json_path : str
# damage_map : dict (optional)
# =========================

# =========================
# OUTPUTS
# T_planes
# T_dims              <-- now 3 items per branch
# T_ids
# T_damage_value      <-- padded
# T_damage_status_int <-- padded
# T_damage_status_txt
# T_damage_type
# T_damage_vertices
# T_damage_uv
# T_damage_desc
# =========================

def parse_damage_map(x):
    # x can be dict already (if you pass it as a dict), or a string from Panel
    if isinstance(x, dict):
        return {str(k).strip().lower(): int(v) for k, v in x.items()}

    if x is None:
        return None

    s = str(x).strip()
    if not s:
        return None

    # try JSON first
    try:
        d = json.loads(s)
        if isinstance(d, dict):
            return {str(k).strip().lower(): int(v) for k, v in d.items()}
    except:
        pass

    return None

DEFAULT_damage_map = {
    "crack": 2,
    "spalling": 3,
    "material loss": 5,
    "staining": 1,
    "chipping": 4
}

def _norm_status(s):
    return str(s).strip().lower()

def _safe_get(dct, path, default=None):
    cur = dct
    for k in path.split("."):
        if not isinstance(cur, dict) or k not in cur:
            return default
        cur = cur[k]
    return cur

def _sort_key(k):
    try:
        return int(k)
    except:
        return str(k)

def _pt(p):
    return rg.Point3d(float(p[0]), float(p[1]), float(p[2]))

def _vec(v):
    return rg.Vector3d(float(v[0]), float(v[1]), float(v[2]))

def frame_dict_to_plane(frame_dict):
    if not frame_dict:
        return None
    p = frame_dict.get("point", None)
    x = frame_dict.get("xaxis", None)
    y = frame_dict.get("yaxis", None)
    if p is None or x is None or y is None:
        return None

    pl = rg.Plane(_pt(p), _vec(x), _vec(y))
    if not pl.IsValid:
        xv = _vec(x); yv = _vec(y)
        xv.Unitize(); yv.Unitize()
        pl = rg.Plane(_pt(p), xv, yv)
    return pl if pl.IsValid else None

def load_json(path):
    with open(path, "r") as f:
        return json.load(f)

def add_to_tree(tree, path, item):
    tree.Add(item, path)

def main(obj, damage_map=None):

    if damage_map is None:
        damage_map = DEFAULT_damage_map

    nodes = _safe_get(obj, "data.graph.node", {}) or {}
    node_keys_sorted = sorted(nodes.keys(), key=_sort_key)

    # Output trees
    T_planes = DataTree[object]()
    T_dims = DataTree[object]()                 # 3 items per branch
    T_ids = DataTree[object]()

    T_damage_value = DataTree[object]()         # padded
    T_damage_status_int = DataTree[object]()    # padded

    T_damage_status_txt = DataTree[object]()
    T_damage_type = DataTree[object]()
    T_damage_vertices = DataTree[object]()
    T_damage_uv = DataTree[object]()
    T_damage_desc = DataTree[object]()

    # ============================================================
    # PASS 1: collect damage lists per brick (for padding)
    # ============================================================
    status_int_lists = []
    value_lists = []

    for node_key in node_keys_sorted:
        node = nodes[node_key] or {}
        damages_dict = node.get("damages", {}) or {}

        status_list = []
        value_list = []

        for dkey in sorted(damages_dict.keys(), key=_sort_key):
            d = damages_dict[dkey] or {}
            status_txt = d.get("status", "")
            status_int = damage_map.get(_norm_status(status_txt), 0)
            value = d.get("value", 0) or 0

            status_list.append(status_int)
            value_list.append(value)

        status_int_lists.append(status_list)
        value_lists.append(value_list)

    max_damages = max([len(lst) for lst in status_int_lists] + [0])

    # ============================================================
    # PASS 2: build trees
    # ============================================================
    for i, node_key in enumerate(node_keys_sorted):

        node = nodes[node_key] or {}
        part = node.get("part", {}) or {}
        part_data = part.get("data", {}) or {}
        part_attrs = part_data.get("attributes", {}) or {}

        path = GH_Path(i)

        # ---- Plane ----
        frame = part_data.get("frame", None) or {}
        plane = frame_dict_to_plane(frame)
        add_to_tree(T_planes, path, plane)

        # ---- Dimensions: ADD AS 3 ITEMS (x, y, z) ----
        shape = part_attrs.get("shape", None) or {}
        shape_data = shape.get("data", None) or {}
        xsize = shape_data.get("xsize", None)
        ysize = shape_data.get("ysize", None)
        zsize = shape_data.get("zsize", None)

        # Add each dimension as separate item in the same branch
        add_to_tree(T_dims, path, xsize)
        add_to_tree(T_dims, path, ysize)
        add_to_tree(T_dims, path, zsize)

        # ---- IDs (one tuple item per branch) ----
        part_key = part_data.get("key", None)
        part_guid = part.get("guid", None)
        qcode = node.get("qcode", None)
        add_to_tree(T_ids, path, (str(node_key), part_key, part_guid, qcode))

        # ---- Raw damage info (existing only) ----
        damages_dict = node.get("damages", {}) or {}
        for dkey in sorted(damages_dict.keys(), key=_sort_key):
            d = damages_dict[dkey] or {}
            add_to_tree(T_damage_status_txt, path, d.get("status", ""))
            add_to_tree(T_damage_type, path, d.get("type", None))
            add_to_tree(T_damage_vertices, path, d.get("vertices", None))
            add_to_tree(T_damage_uv, path, d.get("uv", None))
            add_to_tree(T_damage_desc, path, d.get("description", None))

        # ---- PADDED damage vectors ----
        padded_status = status_int_lists[i] + [0] * (max_damages - len(status_int_lists[i]))
        padded_values = value_lists[i] + [0] * (max_damages - len(value_lists[i]))

        for val in padded_status:
            add_to_tree(T_damage_status_int, path, val)

        for val in padded_values:
            add_to_tree(T_damage_value, path, val)

    return (
        T_planes, T_dims, T_ids,
        T_damage_value, T_damage_status_int,
        T_damage_status_txt, T_damage_type,
        T_damage_vertices, T_damage_uv, T_damage_desc
    )

# -------- run --------
obj = load_json(json_path)

custom_map = parse_damage_map(damage_map)
(T_planes, T_dims, T_ids,
 T_damage_value, T_damage_status_int,
 T_damage_status_txt, T_damage_type,
 T_damage_vertices, T_damage_uv, T_damage_desc) = main(obj, damage_map=custom_map)
# ---------- end py3 ----------
path = FilePath(damaged_brick_path.DATA)
decode_damage = Python3Script(json_path=path, as_points=Toggle(True))  # -> out, brick_id, node_key, brick_size_xyz, stack_id, brick_index, damage_count, damage_types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; inputs json_path: String, as_points: Boolean
# ---------- decode_damage: Python ----------
"""
Grasshopper Python 3 (Rhino) - Brick Damage JSON Parser (file path only)

Inputs:
  json_path : str  - path to a .json file
  as_points : bool - True => Rhino Point3d output, False => raw xyz lists

Outputs:
  brick_id, node_key, brick_size_xyz, stack_id, brick_index
  damage_count
  damage_types, damage_status, damage_values, damage_vertices, damage_uv, damage_desc
  damage_points, damage_xaxis, damage_yaxis
"""

import json
import os
import re

from Rhino.Geometry import Point3d, Vector3d


def _to_point(xyz):
    if xyz is None:
        return None
    return Point3d(float(xyz[0]), float(xyz[1]), float(xyz[2]))

def _to_vec(xyz):
    if xyz is None:
        return None
    return Vector3d(float(xyz[0]), float(xyz[1]), float(xyz[2]))

def _parse_stack_and_index(brick_id_str):
    """
    Expects patterns like 'stack1_brick23'.
    Returns (stack_id:int|None, brick_index:int|None)
    """
    if not brick_id_str:
        return (None, None)
    m = re.match(r"^stack(\d+)_brick(\d+)$", str(brick_id_str).strip())
    if not m:
        return (None, None)
    return (int(m.group(1)), int(m.group(2)))

def _load_json_from_path(path):
    if path is None or not str(path).strip():
        raise ValueError("json_path is empty. Provide a valid file path.")
    path = str(path).strip()

    if not os.path.exists(path):
        raise FileNotFoundError("JSON file not found: {}".format(path))

    with open(path, "r") as f:
        return json.load(f)


# ---- main ----
try:
    data = _load_json_from_path(json_path)

    # Brick-level
    node_key = data.get("nodeKey", None)
    brick_id = data.get("brickId", None)

    bs = data.get("brickSize", {}) or {}
    brick_size_xyz = [bs.get("x", None), bs.get("y", None), bs.get("z", None)]

    stack_id, brick_index = _parse_stack_and_index(brick_id)

    # Damage-level
    damages = data.get("appendDamages", []) or []
    damage_count = len(damages)

    damage_types = []
    damage_status = []
    damage_values = []
    damage_vertices = []
    damage_uv = []
    damage_desc = []

    damage_points = []
    damage_xaxis = []
    damage_yaxis = []

    # Default True if as_points is not wired
    as_points_local = True if as_points is None else bool(as_points)

    for d in damages:
        damage_types.append(d.get("type", None))
        damage_status.append(d.get("status", None))
        damage_values.append(d.get("value", None))
        damage_vertices.append(d.get("vertices", None))
        damage_desc.append(d.get("description", None))

        # uv only exists for face damages
        if "uv" in d and d.get("uv", None) is not None:
            uv = d["uv"]
            damage_uv.append((float(uv[0]), float(uv[1])))
        else:
            damage_uv.append(None)

        coords = d.get("coordinates", {}) or {}
        p = coords.get("point", None)
        xa = coords.get("xaxis", None)
        ya = coords.get("yaxis", None)

        if as_points_local:
            damage_points.append(_to_point(p))
        else:
            damage_points.append(None if p is None else [float(p[0]), float(p[1]), float(p[2])])

        damage_xaxis.append(_to_vec(xa))
        damage_yaxis.append(_to_vec(ya))
        STATUS_MAP = {
    "crack": 2,
    "spalling": 3,
    "material loss": 5,
    "staining": 1,
    "chipping": 4
}

        damage_status_int = []

        for status in damage_status:
            key = str(status).strip().lower()
            damage_status_int.append(STATUS_MAP.get(key, 0))

        

except Exception as e:
    # Fail gracefully in GH: set outputs to safe defaults
    print("ERROR:", e)

    brick_id = None
    node_key = None
    brick_size_xyz = None
    stack_id = None
    brick_index = None

    damage_count = 0
    damage_types = []
    damage_status = []
    damage_values = []
    damage_vertices = []
    damage_uv = []
    damage_desc = []
    damage_points = []
    damage_xaxis = []
    damage_yaxis = []
    damage_status_int= []
# ---------- end decode_damage ----------

item = ListItem(List=decode_damage.brick_size_xyz, Index=0, Wrap=True)  # -> Item, Item1, Item2
toggle = GroupToggle(ToggleActive=True, ToggleVisible=False)  # disabled
sph = Sphere(Base=decode_damage.damage_points, Radius=expr("x*.005", decode_damage.damage_values))
box = CenterBox(Base=PlaneXY(0, 0, 0), X=expr("x/2", item.Item), Y=expr("x/2", item.Item1), Z=expr("x/2", item.Item2))

item_2 = ListItem(List=py3.T_dims, Index=0, Wrap=True)  # -> Item, Item1, Item2

multiplication = Multiplication(A=decode_damage.damage_status_int, B=decode_damage.damage_values)
ma = MassAddition(Input=multiplication)  # -> Result, PartialResults

box_2 = CenterBox(Base=py3.T_planes, X=expr("x/2", item_2.Item), Y=expr("x/2", item_2.Item1), Z=expr("x/2", item_2.Item2))
damage_score = Panel(ma.Result)
deplane = DeconstructPlane(Plane=py3.T_planes)  # -> Origin, XAxis, YAxis, ZAxis
preview = CustomPreview(Geometry=box, Material=ColourSwatch(SwatchColor=RGB(222, 89, 0)))

multiplication_2 = Multiplication(A=py3.T_damage_value, B=py3.T_damage_status_int)
ma_2 = MassAddition(Input=multiplication_2)  # -> Result, PartialResults

move = Move(Geometry=deplane.Origin, Motion=expr("-x*.05", deplane.ZAxis))  # -> Geometry, Transform
concat_2 = Concatenate(FragmentA="Damage_Score: ", FragmentB=ma_2.Result)
flatten = FlattenTree(Tree=py3.T_planes, Path="{0}")
flatten_2 = FlattenTree(Tree=ma_2.Result, Path="{0}")
number_slider = Slider(0.225, range=0..1)
tag = TextTag(Location=move.Geometry, Text=concat_2, Colour=RGB(0, 0, 0))
sort = SortList(Keys=flatten_2, ValuesA=flatten)  # -> Keys, ValuesA
pt = Point(Point(1.171778903, 0.175202513, 0))
dom = ConstructDomain(DomainStart=expr("-x/2", number_slider), DomainEnd=expr("x/2", number_slider))
rectangle = Rectangle(Plane=pt, XSize=dom, YSize=dom, Radius=0)  # -> Rectangle, Length
disc = Discontinuity(Curve=rectangle.Rectangle, Level=1)  # -> Points, Parameters
xy = XYPlane(Origin=disc.Points)
number_slider_2 = Slider(15, range=0..15)
lng = ListLength(List=xy)
series = Series(Start=0, Step=1, Count=lng)
series_2 = Series(Start=0, Step=1, Count=number_slider_2)
pi = Pi(Factor=expr("x/2", series))
rotate = Rotate(Geometry=xy, Angle=pi, Plane=xy)  # -> Geometry, Transform
multiplication_3 = Multiplication(A=series_2, B=item.Item2)
group = Group(Geometry=rotate.Geometry)
Z = UnitZ(Factor=multiplication_3)
panel_3 = Panel("90")
box_3 = CenterBox(Base=rotate.Geometry, X=expr("x/2", item.Item), Y=expr("x/2", item.Item1), Z=expr("x/2", item.Item2))
dom_2 = ConstructDomain(DomainStart=0, DomainEnd=Slider(24.1, range=0..90))
move_2 = Move(Geometry=group, Motion=Z)  # -> Geometry, Transform
range = Range(Domain=dom_2, Steps=expr("x-1", number_slider_2))
rotate_2 = Rotate(Geometry=move_2.Geometry, Angle=degrees(range), Plane=pt)  # -> Geometry, Transform
ungroup = Ungroup(Group=rotate_2.Geometry)
box_4 = CenterBox(Base=ungroup, X=expr("x/2", item.Item), Y=expr("x/2", item.Item1), Z=expr("x/2", item.Item2))
preview_2 = CustomPreview(
    Geometry=box_4,
    Material={diffuse=RGB(221, 160, 221), emission=RGB(66, 48, 66), shine=0.5, specular=RGB(255, 255, 255), transparency=0})
